# Dynamo graph runexternal.dyn (Dynamo 1.3.4.6666)

a_enter_total_square_footage_of = DoubleSlider(1, range=0..100 step 0.1)  # ""A" Enter Total Square Footage of Building"
nof_enter_number_of_floors = DoubleSlider(1, range=0..100 step 0.1)
boolean = BoolSelector(true)
python_script = Python(IN[0]=a_enter_total_square_footage_of, IN[1]=nof_enter_number_of_floors, IN[2]=boolean)
# ---------- python_script.python (7 lines) ----------
import sys
#import imp
sys.path.append(r'C:\\Users\\dbrokaw\\Desktop')
#the path of the python file less the file name C:\\Users\\dbrokaw\\Desktop\\mystuff.py
import mystuff #file name less the .py extension\r\nreload(mystuff)
OUT = mystuff.doit(IN[0], IN[1]) #filename.definition inside file
#imputs are handled in dynamo hence the above IN0 and IN1, IN2 is just a bool",
# ----------------------------------------
